# Dynamo graph Room Cropbox - Copy.dyn "Room Cropbox" (Dynamo 2.13.1.3887)

current = Document.Current()
activeView = Document.ActiveView(document=current)
select_model_element = DSModelElementSelection()  # 1 picked in the model
boundingBox = Element.BoundingBox(element=select_model_element)
setCropBox = View.SetCropBox(view=activeView, boundingBox=boundingBox)
byCorners = BoundingBox.ByCorners()
code_block = CodeBlock(box=boundingBox) { box; offset = 2; min_point = BoundingBox.MinPoint(box); max_point = BoundingBox.MaxPoint(box); }
python_script = Python(IN[0]=code_block.box)  # CPython3
# ---------- python_script.python (50 lines) ----------
import clr
import math
from io import StringIO

import Autodesk
import RevitServices
from Autodesk.Revit.DB import *
from Autodesk.Revit.DB import FilteredElementCollector, Dimension
from Autodesk.Revit.DB import Point
from RevitServices.Persistence import DocumentManager
from RevitServices.Transactions import TransactionManager
from Autodesk.Revit.DB import Dimension, Line, XYZ

clr.AddReference("RevitAPI")
clr.AddReference("RevitServices")

# For Outputting print to watch node
output = StringIO()
sys.stdout = output

doc = DocumentManager.Instance.CurrentDBDocument

def transaction(func):
    def wrapper(*args, **kwargs):
            TransactionManager.Instance.EnsureInTransaction(doc)
            func(*args, **kwargs)
            TransactionManager.Instance.TransactionTaskDone()
    return wrapper

def inc(value, increment):
    if value == 0:
        return increment
    else:
        return value + (increment if value > 0 else -increment)


box = IN[0]
mp = box.MinPoint
offset = 10

new_x = inc(mp.X, offset)
new_y = inc(mp.Y, offset)
new_z = inc(mp.Z, offset)

x = Point.Create(XYZ(new_x, new_y, new_z));

print(mp.X)


OUT = output.getvalue()
# ----------------------------------------
watch = Watch(python_script)
code_block_2 = CodeBlock { point1 = Autodesk.Point.ByCartesianCoordinates(CoordinateSystem.ByOrigin(0, 0, 0), 0, 0, 0); }
