# Dynamo graph Room Cropbox 2.dyn (Dynamo 2.13.1.3887)
# packages: ElementsCropView 0.0.1

select_model_element = DSModelElementSelection()  # 1 picked in the model
current = Document.Current()
activeView = Document.ActiveView(document=current)
code_block = CodeBlock { 2; }
elementsCropView = Custom[ElementsCropView](elements=select_model_element, view=activeView, margin=code_block)  # package ElementsCropView; Given elements, crop View around them
watch = Watch(elementsCropView)
