# Dynamo graph Room Cropbox.dyn (Dynamo 2.13.1.3887)

file_path = Filename(".\Room Cropbox.py")
readText = FileSystem.ReadText(file=file_path)
current = Document.Current()
activeView = Document.ActiveView(document=current)
select_model_element = DSModelElementSelection()  # 1 picked in the model
python_script_from_string = PythonStringNode(script=readText, IN[0]=activeView, IN[1]=select_model_element)  # CPython3
watch = Watch(python_script_from_string)
