# Dynamo graph Complete Centering.dyn (Dynamo 2.13.1.3887)

select_model_element = DSModelElementSelection()  # 1 picked in the model
python_script = Python(IN[0]=select_model_element)  # CPython3
# ---------- python_script.python (49 lines) ----------
import clr
import math
from io import StringIO

import Autodesk
import RevitServices
from Autodesk.Revit.DB import *
from Autodesk.Revit.DB import FilteredElementCollector, Dimension
from Autodesk.Revit.DB import Dimension, Line, XYZ

from RevitServices.Persistence import DocumentManager
from RevitServices.Transactions import TransactionManager

clr.AddReference("RevitAPI")
clr.AddReference("RevitServices")


# For Outputting print to watch node
output = StringIO()
sys.stdout = output

doc = DocumentManager.Instance.CurrentDBDocument

# Import model  

def transaction(func):
    def wrapper(*args, **kwargs):
            TransactionManager.Instance.EnsureInTransaction(doc)
            func(*args, **kwargs)
            TransactionManager.Instance.TransactionTaskDone()
    return wrapper


def print_member(obj):
    for i in dir(obj):
        print(i)

@transaction
def start():
    element = UnwrapElement(IN[0])
    line = element.get_Curve()

    element.TextPosition = line.Origin
    
    for i in element.get_ParametersMap():
        print(i)

start()
OUT = output.getvalue()
# ----------------------------------------
watch = Watch(python_script)
