# Dynamo graph Create Unit Views - Copy.dyn "Create Unit Views" (Dynamo 2.13.1.3887)
# packages: Rhythm 2023.5.5

code_block = CodeBlock { "View Name"; }
code_block_2 = CodeBlock { 0; "PV-"; }
insert = String.Insert(index=code_block_2.out0, toInsert=code_block_2.out1)  # unwired: string
setParameterByName = Element.SetParameterByName(parameterName=code_block, value=insert)  # unwired: element
name_to_edit = StringInput("A-EL-C")
name_to_replace = StringInput("EL-C-A")
replace = String.Replace(searchFor=name_to_edit, replaceWith=name_to_replace)  # unwired: string

# group: Get View Name Parameter
code_block_3 = CodeBlock { "View Name"; }
getParameterValueByName = Element.GetParameterValueByName(parameterName=code_block_3)  # unwired: element

categories = Categories("OST_Views")

# group: Get All Elements
all_elements_of_category = ElementsOfCategory(Category=categories)
code_block_4 = CodeBlock { false; }
clean = List.Clean(list=all_elements_of_category, preserveIndices=code_block_4)

# group: Filter Parameter for Presentation Views Only
code_block_5 = CodeBlock { "View Type"; "Presentation Views"; "Equals"; }
ʳʰʸᵗʰᵐ_elementfilter = Rhythm.Revit.ElementFilter.ElementFilter.ByParameterStringValue(elements=clean, parameterName=code_block_5.out0, value=code_block_5.out1, filterMethod=code_block_5.out2)
code_block_6 = CodeBlock { "View Name"; ""; "DoesNotEqual"; }
ʳʰʸᵗʰᵐ_clean_views = Rhythm.Revit.ElementFilter.ElementFilter.ByParameterStringValue(elements=ʳʰʸᵗʰᵐ_elementfilter, parameterName=code_block_6.out0, value=code_block_6.out1, filterMethod=code_block_6.out2)

# group: Get Discipline View
code_block_7 = CodeBlock()
# ---------- code_block_7.designscript (21 lines) ----------
"Discipline";

// Archictectural;
"1";

// Structural;
"2";

// Mechanical;
"4";

// Electrical;
"8";

// Plumbing;
"16";

// Plumbing;
"4095";

"Equals";
# ----------------------------------------
ʳʰʸᵗʰᵐ_elementfilter_2 = Rhythm.Revit.ElementFilter.ElementFilter.ByParameterStringValue(elements=ʳʰʸᵗʰᵐ_clean_views, parameterName=code_block_7.out0, value=code_block_7.out1, filterMethod=code_block_7.out7)

# group: Choose View Type
code_block_8 = CodeBlock { "Floor Plan"; "Ceiling Plan"; }
filter_by_view_type = Python(IN[0]=ʳʰʸᵗʰᵐ_elementfilter_2, IN[1]=code_block_8.out0)  # CPython3
# ---------- filter_by_view_type.python (50 lines) ----------
import clr
import math
from io import StringIO

import Autodesk
import RevitServices
from Autodesk.Revit.DB import *
from Autodesk.Revit.DB import FilteredElementCollector, Dimension
from Autodesk.Revit.DB import Point, ViewType
from RevitServices.Persistence import DocumentManager
from RevitServices.Transactions import TransactionManager
from Autodesk.Revit.DB import Dimension, Line, XYZ


clr.AddReference('RevitServices')
clr.AddReference('RevitAPI')
clr.AddReference('RevitNodes')
clr.AddReference('RevitAPIUI')
# For Outputting print to watch node
output = StringIO()
sys.stdout = output

doc = DocumentManager.Instance.CurrentDBDocument
elements = UnwrapElement(IN[0])

view_type = IN[1]

result = []

def transaction(func):
    def wrapper(*args, **kwargs):
            TransactionManager.Instance.EnsureInTransaction(doc)
            func(*args, **kwargs)
            TransactionManager.Instance.TransactionTaskDone()
    return wrapper

@transaction
def start():
    for i in elements:
        if view_type == "Floor Plan" and i.ViewType == ViewType.FloorPlan:
            result.append(i)
            continue
        if view_type == "Ceiling Plan" and i.ViewType == ViewType.CeilingPlan:
            result.append(i)
            continue

start()

# OUT = output.getvalue()
OUT = result
# ----------------------------------------
watch = Watch(filter_by_view_type)

base_view_model = CodeBlock { "PV-AR-P-A-04-U"; }

# group: Remove Views in Sheets
filter_out_sheet_views = Python(IN[0]=filter_by_view_type, IN[1]=base_view_model)  # CPython3
# ---------- filter_out_sheet_views.python (56 lines) ----------
import clr
import math
from io import StringIO

import Autodesk
import RevitServices
from Autodesk.Revit.DB import *
from Autodesk.Revit.DB import ViewPlacementOnSheetStatus, Dimension
from Autodesk.Revit.DB import Point, ViewType
from RevitServices.Persistence import DocumentManager
from RevitServices.Transactions import TransactionManager
from Autodesk.Revit.DB import Dimension, Line, XYZ


clr.AddReference('RevitServices')
clr.AddReference('RevitAPI')
clr.AddReference('RevitNodes')
clr.AddReference('RevitAPIUI')
# For Outputting print to watch node
output = StringIO()
sys.stdout = output

doc = DocumentManager.Instance.CurrentDBDocument
elements = UnwrapElement(IN[0])

base_view_model = UnwrapElement(IN[1])


def transaction(func):
    def wrapper(*args, **kwargs):
            TransactionManager.Instance.EnsureInTransaction(doc)
            func(*args, **kwargs)
            TransactionManager.Instance.TransactionTaskDone()
    return wrapper
result = []

@transaction
def start():
    for i in elements:
        if i.Name == base_view_model: continue
        sheet_status = i.GetPlacementOnSheetStatus()
        if sheet_status == ViewPlacementOnSheetStatus.NotApplicable:
            print("Not Applicable")
            result.append(i)
        if sheet_status == ViewPlacementOnSheetStatus.NotPlaced:
            print("Not Placed")
            result.append(i)
        if sheet_status == ViewPlacementOnSheetStatus.PartiallyPlaced:
            print("Partially Placed")
        if sheet_status == ViewPlacementOnSheetStatus.CompletelyPlaced:
            print("Completely Placed")

start()

# OUT = output.getvalue()
OUT = result
# ----------------------------------------
watch_2 = Watch(filter_out_sheet_views)

duplicate = BoolSelector(true)
duplicate_unit_views = Python(IN[0]=filter_out_sheet_views, IN[1]=duplicate)  # CPython3
# ---------- duplicate_unit_views.python (102 lines) ----------
import clr
import math
from io import StringIO
import inspect
import Autodesk
import RevitServices
from Autodesk.Revit.DB import *
from Autodesk.Revit.DB import ViewDuplicateOption, Dimension
from Autodesk.Revit.DB import ViewFamilyType, ViewType
from Autodesk.Revit.DB import FilteredElementCollector, Line, XYZ
from RevitServices.Persistence import DocumentManager
from RevitServices.Transactions import TransactionManager

from Revit.Elements import Element

clr.AddReference('RevitServices')
clr.AddReference('RevitAPI')
clr.AddReference('RevitNodes')
clr.AddReference('RevitAPIUI')
# For Outputting print to watch node
output = StringIO()
sys.stdout = output

doc = DocumentManager.Instance.CurrentDBDocument
elements = UnwrapElement(IN[0])



def transaction(func):
    def wrapper(*args, **kwargs):
            TransactionManager.Instance.EnsureInTransaction(doc)
            func(*args, **kwargs)
            TransactionManager.Instance.TransactionTaskDone()
    return wrapper

def print_member(obj):
    for i in dir(obj):
        print(i)

def duplicate_view(view, name, view_type):
    newId = view.Duplicate(ViewDuplicateOption.Duplicate)
    newView = doc.GetElement(newId)
    newView.CropBoxVisible = False
    newView.Name = name
    newView.ViewType = view_type
    return newView


def change_view_type(plan_view, view_type):
    Element.SetParameterByName(plan_view, "Type", view_type.Id)

def get_viewtype(doc, view_type_name):
    collector = FilteredElementCollector(doc)
    view_types = collector.OfClass(ViewFamilyType).ToElements()
    for vt in view_types:
        if vt.get_Name() == view_type_name:
            return vt
    return None

def get_elementType(doc):
    elems = FilteredElementCollector(doc).OfClass(ViewFamilyType).ToElements()
    for i in elems:
        print(i)

def replace_text_at_end(s, old_suffix, new_suffix):
    if s.endswith(old_suffix):
        return s[:-len(old_suffix)] + new_suffix
    return s.strip()

floor_type = "Architectural Unit Plan"

exists = []
to_change = []
@transaction
def start():
    

    new_view_type = get_viewtype(doc, floor_type)
    # get_elementType(doc)
    for i in elements:
        if i.Name.endswith("-U"):
            exists.append(i.Name)
    

    for i in elements:
        # change_view_type(i, new_view_type)
        if i.Name.endswith("-U"): continue
        if i.Name + "-U" in exists:
            to_change.append(i)
        #     change_view_type(i, new_view_type)
        # duplicate_view(i, i.Name + "-U", new_view_type)
start()


# OUT = result

        # duplicate_view(i, i.Name + "-U", new_view_type)

start()

OUT = output.getvalue()
OUT = to_change
# ----------------------------------------
watch_3 = Watch(duplicate_unit_views)
code_block_9 = CodeBlock { "Type"; }
python_script = Python(IN[0]=duplicate_unit_views)  # CPython3
# ---------- python_script.python (18 lines) ----------
import clr

#Import the Revit API
clr.AddReference('RevitAPI')
import Autodesk
from Autodesk.Revit.DB import *

#Import DocumentManager and TransactionManager
clr.AddReference('RevitServices')
import RevitServices
from RevitServices.Persistence import DocumentManager

#Reference the active Document and application
doc = DocumentManager.Instance.CurrentDBDocument

#Start scripting here:

OUT = FilteredElementCollector(doc).OfClass(ViewFamilyType).ToElements()
# ----------------------------------------
code_block_10 = CodeBlock(name=python_script) { name[35]; }
setParameterByName_2 = Element.SetParameterByName(element=duplicate_unit_views, parameterName=code_block_9, value=code_block_10)
watch_4 = Watch(python_script)
code_block_11 = CodeBlock(e=python_script) { e.Name; }
