# Dynamo graph Get Disciplines.dyn (Dynamo 2.13.1.3887)

python_script = Python()  # CPython3; unwired: IN[0]
# ---------- python_script.python (29 lines) ----------
import clr

# Import Revit API DLLs
clr.AddReference('RevitAPI')
clr.AddReference('RevitServices')

from Autodesk.Revit.DB import FilteredElementCollector, ViewPlan
from RevitServices.Persistence import DocumentManager
from collections import OrderedDict

# Get the current Revit document
doc = DocumentManager.Instance.CurrentDBDocument

# Create a collector to get all views in the project
views_collector = FilteredElementCollector(doc).OfClass(ViewPlan)

# Initialize a set to hold unique disciplines
disciplines = []

# Iterate through all views and collect disciplines
for view in views_collector:

    disciplines.append(view.Discipline)

# Convert disciplines from Revit API enumerations to string
discipline_names = [discipline for discipline in disciplines]
mylist = OrderedDict((x, True) for x in discipline_names).keys()
# Output the list of disciplines
OUT = mylist
# ----------------------------------------
watch = Watch(python_script)
