# Dynamo graph Create Copy Plan.dyn (Dynamo 2.13.1.3887)

code_block = CodeBlock()
# ---------- code_block.designscript (11 lines) ----------
// target_view_type
"Presentation Views";
"Working Views";
"Base Views";

// Discipline
"Lighting";
"Power";
"Data";
"Infrastructure";
"Device";
# ----------------------------------------
to_delete = BoolSelector(true)
unit_crop_combined_py = Python(IN[0]=code_block.out0, IN[1]=to_delete)  # CPython3; unwired: IN[2]
# ---------- unit_crop_combined_py.python (152 lines) ----------
import clr
import math
from io import StringIO

import Autodesk
import RevitServices
from Autodesk.Revit.DB import *
from Autodesk.Revit.DB import FilteredElementCollector, ViewPlan,ViewDuplicateOption , BuiltInCategory, ElementTransformUtils, FamilyInstance

from RevitServices.Persistence import DocumentManager
from RevitServices.Transactions import TransactionManager
from Autodesk.Revit.DB import CurveLoop, DetailLine, XYZ, FilledRegion, ElementId, Electrical

clr.AddReference('System')
from System.Collections.Generic import  IList 

clr.AddReference("RevitAPI")
clr.AddReference("RevitServices")

class MyException(Exception):
    pass

# For Outputting print to watch node
output = StringIO()
sys.stdout = output

doc = DocumentManager.Instance.CurrentDBDocument
active_view = doc.ActiveView

def transaction(func):
  def wrapper(*args, **kwargs):
      TransactionManager.Instance.EnsureInTransaction(doc)
      func(*args, **kwargs)
      TransactionManager.Instance.TransactionTaskDone()
  return wrapper

def print_member(obj):
  for i in dir(obj):
    print(i)

def get_element(id):
  if isinstance(id, str):
    return doc.GetElement(ElementId(id))
  elif isinstance(id, ElementId):
    return doc.GetElement(id)
  return None

def get_elements(ids):
  elements = []
  if all(isinstance(item, ElementId) for item in ids):
    for id in ids:
      elements.append(doc.GetElement(id))
  if all(isinstance(item, int) for item in ids):
    for id in ids:
      x = doc.GetElement(ElementId(id))
      elements.append(x)
  return elements

def get_element_via_parameter(elements, parameter_name, parameter_value):
  result = []
  for el in elements:
    param_ViewType = el.GetParameters(parameter_name)[0]
    if param_ViewType.AsValueString() == parameter_value:
      result.append(el)
      continue
  return result

def get_num(str):
  res = ''.join(char for char in str if char.isdigit())
  if res:
    return int(res)
  else: return None


def get_room_curve(group_elements):
  room_curve = CurveLoop()
  for id in group_elements:
    e = doc.GetElement(id)
    if isinstance(e, DetailLine):
      line = e.GeometryCurve
      room_curve.Append(line)
  return room_curve
 

def get_view_range(target_view_type, target_discipline, range_value=None):
    result = []
    view_list = FilteredElementCollector(doc).OfClass(ViewPlan).ToElements()
    for view in view_list:
        view_type = view.LookupParameter("View Type").AsValueString()
        if view_type != target_view_type: continue

        discipline = view.LookupParameter("Type").AsValueString()
        if discipline != target_discipline: continue

        if range_value:
          min_range = range_value[0]
          max_range = range_value[1]

          level = get_num(view.Name)
          if min_range <= level <= max_range:
              result.append(view)
              continue
          
        else:
          result.append(view)
          continue
          
    return result


@transaction 
def start():
    # Types
    floor_type = ElementId(1969664)
    view_template = ElementId(2921754)

    # Get levels
    source_views = get_view_range("Utility Views", "Dynamo Crop Plan")
    for view in source_views:
      if "Level 4A" not in view.Name:  continue
      new_view = ViewPlan.Create(doc, floor_type, view.GenLevel.Id)

 
      new_view.ViewTemplateId = view_template
      new_view.Name = view.Name.replace("D_Crop", "W_Device")
      new_view.CropBoxVisible = True
      new_view.CropBoxActive = True
      # break 
      if "Level 4A" in view.Name: 
          
          filled_region_list = FilteredElementCollector(doc, view.Id).OfClass(FilledRegion).ToElements()
          for filreg in filled_region_list:
            dupli_id = new_view.Duplicate(ViewDuplicateOption.AsDependent)
            dupli_view = get_element(dupli_id)
            crop_shape = filreg.GetBoundaries()[0]
            crop_manager = dupli_view.GetCropRegionShapeManager()
            crop_manager.SetCropShape(crop_shape)

            name = filreg.LookupParameter("Comments").AsValueString()
            dupli_view.Name = f"W_Device Unit 04 ({name})"
          continue
    
      filreg = FilteredElementCollector(doc, view.Id).OfClass(FilledRegion).ToElements()
      crop_shape = filreg[0].GetBoundaries()[0]
      crop_manager = new_view.GetCropRegionShapeManager()
      crop_manager.SetCropShape(crop_shape)

      # print(crop_manager.GetCropShape())
      # break
start()

OUT = output.getvalue()
# ----------------------------------------
watch = Watch(unit_crop_combined_py)
