# Dynamo graph Level Copy.dyn (Dynamo 2.13.1.3887)

proceed = BoolSelector(true)
base_level = Levels("LEVEL 4A")
all_elements_at_level = ElementsAtLevel(Level=base_level)
target_plans_ceiling = CodeBlock()
# ---------- target_plans_ceiling.designscript (32 lines) ----------
base_plan = "2442306";
 // LEVEL 4A;

plans = [
	"2442315", // LEVEL 5A
	"2442324", // LEVEL 6A
	"2442333", // LEVEL 7A
	"2442342", // LEVEL 8A
	"2442351", // LEVEL 9A
	"2442360", // LEVEL 10A
	"2442369", // LEVEL 11A
	"2442378", // LEVEL 12A
	"2442387", // LEVEL 13A
	"2442396", // LEVEL 14A
	"2442405", // LEVEL 15A
	"2442414", // LEVEL 16A
	"2442423", // LEVEL 17A
	"2442432", // LEVEL 18A
	"2442441", // LEVEL 19A
	"2442450", // LEVEL 20A
	"2442459", // LEVEL 21A
	"2442468", // LEVEL 22A
	"2442477", // LEVEL 23A
	"2442486", // LEVEL 24A
	"2442495", // LEVEL 25A
	"2442504", // LEVEL 26A
	"2442513", // LEVEL 27A
	"2442522", // LEVEL 28A
	"2442531", // LEVEL 29A
	"2442540", // LEVEL 30A
	"2442549" // LEVEL 31A
];
# ----------------------------------------
target_levels = CodeBlock()
# ---------- target_levels.designscript (29 lines) ----------
levels = [
	"1362436", // LEVEL 5A
	"1362437", // LEVEL 6A
	"1362438", // LEVEL 7A
	"1362439", // LEVEL 8A
	"1362440", // LEVEL 9A
	"1362441", // LEVEL 10A
	"1362442", // LEVEL 11A
	"1362443", // LEVEL 12A
	"1362444", // LEVEL 13A
	"1362445", // LEVEL 14A
	"1362446", // LEVEL 15A
	"1362447", // LEVEL 16A
	"1362448", // LEVEL 17A
	"1362449", // LEVEL 18A
	"1362450", // LEVEL 19A
	"1362451", // LEVEL 20A
	"1362452", // LEVEL 21A
	"1362453", // LEVEL 22A
	"1362454", // LEVEL 23A
	"1362455", // LEVEL 24A
	"1362456", // LEVEL 25A
	"1362457", // LEVEL 26A
	"1362458", // LEVEL 27A
	"1362459", // LEVEL 28A
	"1362460", // LEVEL 29A
	"1362461", // LEVEL 30A
	"1362462" // LEVEL 31A
];
# ----------------------------------------
target_levels_get = Python(IN[0]=target_levels)  # CPython3
# ---------- target_levels_get.python (53 lines) ----------
import clr
import math
from io import StringIO

import Autodesk
import RevitServices
from Autodesk.Revit.DB import *
from Autodesk.Revit.DB import FilteredElementCollector, Dimension

from RevitServices.Persistence import DocumentManager
from RevitServices.Transactions import TransactionManager
from Autodesk.Revit.DB import Dimension, Line, XYZ

clr.AddReference("RevitAPI")
clr.AddReference("RevitServices")


# For Outputting print to watch node
output = StringIO()
sys.stdout = output
result = []
doc = DocumentManager.Instance.CurrentDBDocument

def transaction(func):
    def wrapper(*args, **kwargs):
            TransactionManager.Instance.EnsureInTransaction(doc)
            func(*args, **kwargs)
            TransactionManager.Instance.TransactionTaskDone()
    return wrapper
 
def print_member(obj):
  for i in dir(obj):
      print(i)

@transaction
def start():
  target_levels = UnwrapElement(IN[0])

  # Get all levels in the document
  collector = FilteredElementCollector(doc).OfClass(Level)
  levels = collector.ToElements()

  # Create a list of level names
  for level in levels:
      lvl_name = level.Name
      lvl_id = level.Id.ToString()
      if lvl_id in target_levels:
        result.append(level)


start()

OUT = result
# ----------------------------------------
watch = Watch(target_levels_get)
level_copy = Python(IN[0]=proceed, IN[1]=all_elements_at_level, IN[2]=target_plans_ceiling.plans, IN[3]=watch)  # CPython3
# ---------- level_copy.python (85 lines) ----------
import clr
import math
from io import StringIO

import Autodesk
import RevitServices
from Autodesk.Revit.DB import *
from Autodesk.Revit.DB import FilteredElementCollector, IndependentTag,BuiltInParameter, BuiltInCategory, ElementTransformUtils

from RevitServices.Persistence import DocumentManager
from RevitServices.Transactions import TransactionManager
from Autodesk.Revit.DB import Dimension, Line, XYZ, Group


clr.AddReference("RevitAPI")
clr.AddReference("RevitServices")


# For Outputting print to watch node
output = StringIO()
sys.stdout = output

doc = DocumentManager.Instance.CurrentDBDocument

def transaction(func):
    def wrapper(*args, **kwargs):
            TransactionManager.Instance.EnsureInTransaction(doc)
            func(*args, **kwargs)
            TransactionManager.Instance.TransactionTaskDone()
    return wrapper
 
def print_member(obj):
  for i in dir(obj):
      print(i)

def copy_to_level(element, target_level):
  transform = XYZ(0, 0, 0)
  elementId = element.Id

  copied_id = ElementTransformUtils.CopyElement(doc, elementId, transform)
  copied_instance = doc.GetElement(copied_id[0])

  print("ID: ", copied_id[0])
  reference_level = copied_instance.GetParameters("Reference Level")[0]
  reference_level.Set(target_level.Id)


proceed = UnwrapElement(IN[0])
elements = UnwrapElement(IN[1])
target_plans= UnwrapElement(IN[2])
target_levels = UnwrapElement(IN[3])


@transaction 
def start():
  t_level = target_levels[0] # Temporary
  print(t_level.Id)
  
  # Fliter Groups
  for e in elements:
    if isinstance(e, Group):
      copy_to_level(e, t_level)



      # collector = FilteredElementCollector(doc).OfCategory(BuiltInCategory. OST_GenericAnnotation) \
      #                                            .WhereElementPropertyEquals(BuiltInParameter.LEVEL_PARAM, t_level.Id)
      # # elems = [e for e in e.GetMemberIds() if isinstance(doc.GetElement(e), IndependentTag)]
      
      # print(collector)
      # # for  i in e.GetMemberIds():
      # #   a = doc.GetElement(i)
      # #   print(a.Name)


    break
  
   
if proceed:
  print("Starting Script")
  start()
else:
  print("Script not enabled")

OUT = output.getvalue()
# ----------------------------------------
watch_2 = Watch(level_copy)
which_to_print = CodeBlock { "Level"; "Plan"; }

# group: Get All Elements
categories = Categories("OST_Views")
all_elements_of_category = ElementsOfCategory(Category=categories)
code_block = CodeBlock { false; }
clean = List.Clean(list=all_elements_of_category, preserveIndices=code_block)

level_printer = Python(IN[0]=which_to_print.out0, IN[1]=clean)  # CPython3
# ---------- level_printer.python (93 lines) ----------
import clr
import math
from io import StringIO

import Autodesk
import RevitServices
from Autodesk.Revit.DB import *
from Autodesk.Revit.DB import ViewType
from Autodesk.Revit.DB import FilteredElementCollector, Dimension

from RevitServices.Persistence import DocumentManager
from RevitServices.Transactions import TransactionManager
from Autodesk.Revit.DB import Dimension, Line, XYZ, Level

clr.AddReference("RevitAPI")
clr.AddReference("RevitServices")


# For Outputting print to watch node
output = StringIO()
sys.stdout = output
result = []
doc = DocumentManager.Instance.CurrentDBDocument

def transaction(func):
    def wrapper(*args, **kwargs):
            TransactionManager.Instance.EnsureInTransaction(doc)
            func(*args, **kwargs)
            TransactionManager.Instance.TransactionTaskDone()
    return wrapper
 
def print_member(obj):
  for i in dir(obj):
      print(i)

def get_element_via_parameter(elements, parameter_name, parameter_value):
    result = []
    for el in elements:
        param_ViewType = el.GetParameters(parameter_name)[0]
        if param_ViewType.AsValueString() == parameter_value:
            result.append(el)
            continue
    return result


def get_all_view_type(elements, view_type):
    result = []
    for el in elements:
        if el.ViewType == view_type:
            result.append(el)
    return result

plan_dict = {
    "Floor Plan": ViewType.FloorPlan,
    "Ceiling Plan": ViewType.CeilingPlan
}

family_dict = {
    "Floor Plan": ViewFamily.FloorPlan,
    "Ceiling Plan": ViewFamily.CeilingPlan
}

to_print = UnwrapElement(IN[0])
elements = UnwrapElement(IN[1])

@transaction
def start():
  target_levels = UnwrapElement(IN[0])

  print(f"To print: {to_print}\n")
  if to_print == "Level":
    # Get all levels in the document
    collector = FilteredElementCollector(doc).OfClass(Level)
    levels = collector.ToElements()

    # Create a list of level names
    for level in levels:
      print(f'"{level.Id.ToString()}", // {level.Name}')

  # Print all plan
  elif to_print == "Plan":
    discipline_type = "Electrical"
    plan_type = "Ceiling Plan"
    elem_discipline = get_element_via_parameter(elements, "Discipline", discipline_type)
    elem_plan = get_all_view_type(elem_discipline, plan_dict[plan_type])
    for plan in elem_plan:
      print(f'"{plan.Id}", // {plan.Name}')


start()

OUT = result
OUT = output.getvalue()
# ----------------------------------------
watch_3 = Watch(level_printer)
