# Dynamo graph Plan Copy.dyn (Dynamo 2.13.1.3887)

boolean = BoolSelector(true)
target_plans_ceiling = CodeBlock()
# ---------- target_plans_ceiling.designscript (32 lines) ----------
base_plan = "2442306";
 // LEVEL 4A;

plans = [
	"2442315", // LEVEL 5A
	"2442324", // LEVEL 6A
	"2442333", // LEVEL 7A
	"2442342", // LEVEL 8A
	"2442351", // LEVEL 9A
	"2442360", // LEVEL 10A
	"2442369", // LEVEL 11A
	"2442378", // LEVEL 12A
	"2442387", // LEVEL 13A
	"2442396", // LEVEL 14A
	"2442405", // LEVEL 15A
	"2442414", // LEVEL 16A
	"2442423", // LEVEL 17A
	"2442432", // LEVEL 18A
	"2442441", // LEVEL 19A
	"2442450", // LEVEL 20A
	"2442459", // LEVEL 21A
	"2442468", // LEVEL 22A
	"2442477", // LEVEL 23A
	"2442486", // LEVEL 24A
	"2442495", // LEVEL 25A
	"2442504", // LEVEL 26A
	"2442513", // LEVEL 27A
	"2442522", // LEVEL 28A
	"2442531", // LEVEL 29A
	"2442540", // LEVEL 30A
	"2442549" // LEVEL 31A
];
# ----------------------------------------
python_script = Python(IN[0]=boolean, IN[1]=target_plans_ceiling.base_plan, IN[2]=target_plans_ceiling.plans)  # CPython3
# ---------- python_script.python (102 lines) ----------
import clr
import math
from io import StringIO

import Autodesk
import RevitServices
from Autodesk.Revit.DB import *
from Autodesk.Revit.DB import FilteredElementCollector, IndependentTag,BuiltInParameter, BuiltInCategory, ElementTransformUtils

from RevitServices.Persistence import DocumentManager
from RevitServices.Transactions import TransactionManager
from Autodesk.Revit.DB import Dimension, Line, XYZ, Group, ElementId

clr.AddReference('System')
from System.Collections.Generic import List

clr.AddReference("RevitAPI")
clr.AddReference("RevitServices")


# For Outputting print to watch node
output = StringIO()
sys.stdout = output

doc = DocumentManager.Instance.CurrentDBDocument
active_view = doc.ActiveView

def transaction(func):
    def wrapper(*args, **kwargs):
            TransactionManager.Instance.EnsureInTransaction(doc)
            func(*args, **kwargs)
            TransactionManager.Instance.TransactionTaskDone()
    return wrapper
 
def print_member(obj):
  for i in dir(obj):
      print(i)

def copy_to_level(element, target_level):
  transform = XYZ(0, 0, 0)
  elementId = element.Id

  copied_id = ElementTransformUtils.CopyElement(doc, elementId, transform)
  copied_instance = doc.GetElement(copied_id[0])

  print("ID: ", copied_id[0])
  reference_level = copied_instance.GetParameters("Reference Level")[0]
  reference_level.Set(target_level.Id)

def get_element(id_str):
   return doc.GetElement(ElementId(id_str))


proceed = UnwrapElement(IN[0])
base_plan_id = UnwrapElement(IN[1])
target_plans = UnwrapElement(IN[2])

# 2680980

exception_categories = [
   int(BuiltInCategory.OST_RvtLinks),
   int(BuiltInCategory.OST_Grids),
   int(BuiltInCategory.OST_SectionBox),
   int(BuiltInCategory.OST_Cameras),
   int(BuiltInCategory.OST_Elev),
   int(BuiltInCategory.OST_Viewers),
]

@transaction 
def start():

  base_plan = get_element(base_plan_id)
  t_plan = get_element(target_plans[0])
  elements_in_source_view = FilteredElementCollector(doc, base_plan.Id).WhereElementIsNotElementType().ToElements()

  processed_elems = []

  print("View: ", t_plan.GetPrimaryViewId())

  for e in elements_in_source_view:
    category = e.Category

    if not category or (category and category.Id.IntegerValue in exception_categories):
      continue
    
    processed_elems.append(e.Id)
    print(f'[{e.Name}], [{e.Id}]')

  # print(base_plan, t_plan)
  filtered = List[ElementId](processed_elems)

  copied_element = ElementTransformUtils.CopyElements(base_plan, filtered, t_plan, Transform.Identity, CopyPasteOptions())
  print("Copied Elements: ", copied_element)


if proceed:
  print("Starting Script")
  start()
else:
  print("Script not enabled")

OUT = output.getvalue()
# ----------------------------------------
watch = Watch(python_script)
which_to_print = CodeBlock { "Level"; "Plan"; }

# group: Get All Elements
categories = Categories("OST_Views")
all_elements_of_category = ElementsOfCategory(Category=categories)
code_block = CodeBlock { false; }
clean = List.Clean(list=all_elements_of_category, preserveIndices=code_block)

level_printer = Python(IN[0]=which_to_print.out1, IN[1]=clean)  # CPython3
# ---------- level_printer.python (93 lines) ----------
import clr
import math
from io import StringIO

import Autodesk
import RevitServices
from Autodesk.Revit.DB import *
from Autodesk.Revit.DB import ViewType
from Autodesk.Revit.DB import FilteredElementCollector, Dimension

from RevitServices.Persistence import DocumentManager
from RevitServices.Transactions import TransactionManager
from Autodesk.Revit.DB import Dimension, Line, XYZ, Level

clr.AddReference("RevitAPI")
clr.AddReference("RevitServices")


# For Outputting print to watch node
output = StringIO()
sys.stdout = output
result = []
doc = DocumentManager.Instance.CurrentDBDocument

def transaction(func):
    def wrapper(*args, **kwargs):
            TransactionManager.Instance.EnsureInTransaction(doc)
            func(*args, **kwargs)
            TransactionManager.Instance.TransactionTaskDone()
    return wrapper
 
def print_member(obj):
  for i in dir(obj):
      print(i)

def get_element_via_parameter(elements, parameter_name, parameter_value):
    result = []
    for el in elements:
        param_ViewType = el.GetParameters(parameter_name)[0]
        if param_ViewType.AsValueString() == parameter_value:
            result.append(el)
            continue
    return result


def get_all_view_type(elements, view_type):
    result = []
    for el in elements:
        if el.ViewType == view_type:
            result.append(el)
    return result

plan_dict = {
    "Floor Plan": ViewType.FloorPlan,
    "Ceiling Plan": ViewType.CeilingPlan
}

family_dict = {
    "Floor Plan": ViewFamily.FloorPlan,
    "Ceiling Plan": ViewFamily.CeilingPlan
}

to_print = UnwrapElement(IN[0])
elements = UnwrapElement(IN[1])

@transaction
def start():
  target_levels = UnwrapElement(IN[0])

  print(f"To print: {to_print}\n")
  if to_print == "Level":
    # Get all levels in the document
    collector = FilteredElementCollector(doc).OfClass(Level)
    levels = collector.ToElements()

    # Create a list of level names
    for level in levels:
      print(f'"{level.Id.ToString()}", // {level.Name}')

  # Print all plan
  elif to_print == "Plan":
    discipline_type = "Electrical"
    plan_type = "Ceiling Plan"
    elem_discipline = get_element_via_parameter(elements, "Discipline", discipline_type)
    elem_plan = get_all_view_type(elem_discipline, plan_dict[plan_type])
    for plan in elem_plan:
      print(f'"{plan.Id}", // {plan.Name}')


start()

OUT = result
OUT = output.getvalue()
# ----------------------------------------
watch_2 = Watch(level_printer)
