# Dynamo graph Rename - Multiple.dyn (Dynamo 2.13.1.3887)

categories = Categories("OST_Views")

# group: Get All Elements
all_elements_of_category = ElementsOfCategory(Category=categories)
code_block = CodeBlock { false; }
clean = List.Clean(list=all_elements_of_category, preserveIndices=code_block)

# group: Get View Name Parameter
code_block_2 = CodeBlock { "View Name"; }
getParameterValueByName = Element.GetParameterValueByName(element=clean, parameterName=code_block_2)

# group: Set View Name
code_block_3 = CodeBlock { "View Name"; }
name_to_edit = StringInput("PV-B-ST-P")
name_to_replace = StringInput("B-ST-P")
replace = String.Replace(string=getParameterValueByName, searchFor=name_to_edit, replaceWith=name_to_replace)
setParameterByName = Element.SetParameterByName(element=clean, parameterName=code_block_3, value=replace)
