# Dynamo graph Rename.dyn (Dynamo 2.13.1.3887)
# packages: Rhythm 2023.5.5

code_block = CodeBlock()
# ---------- code_block.designscript (19 lines) ----------
"Discipline";

// Archictectural;
"1";

// Structural;
"2";

// Mechanical;
"4";

// Electrical;
"8";

// Plumbing;
"16";

// Plumbing;
"4095";
# ----------------------------------------
categories = Categories("OST_Views")

# group: Get All Elements
all_elements_of_category = ElementsOfCategory(Category=categories)
code_block_2 = CodeBlock { false; }
clean = List.Clean(list=all_elements_of_category, preserveIndices=code_block_2)

# group: Filter Parameter for Presentation Views Only
code_block_3 = CodeBlock { "View Type"; "Presentation Views"; "Equals"; }
ʳʰʸᵗʰᵐ_elementfilter = Rhythm.Revit.ElementFilter.ElementFilter.ByParameterStringValue(elements=clean, parameterName=code_block_3.out0, value=code_block_3.out1, filterMethod=code_block_3.out2)
code_block_4 = CodeBlock { "View Name"; ""; "DoesNotEqual"; }
ʳʰʸᵗʰᵐ_elementfilter_2 = Rhythm.Revit.ElementFilter.ElementFilter.ByParameterStringValue(elements=ʳʰʸᵗʰᵐ_elementfilter, parameterName=code_block_4.out0, value=code_block_4.out1, filterMethod=code_block_4.out2)

code_block_5 = CodeBlock { "View Name"; }

# group: Get View Name Parameter
code_block_6 = CodeBlock { "View Name"; }
getParameterValueByName = Element.GetParameterValueByName(element=ʳʰʸᵗʰᵐ_elementfilter_2, parameterName=code_block_6)

code_block_7 = CodeBlock { 0; "PV-"; }
insert = String.Insert(string=getParameterValueByName, index=code_block_7.out0, toInsert=code_block_7.out1)
setParameterByName = Element.SetParameterByName(element=ʳʰʸᵗʰᵐ_elementfilter_2, parameterName=code_block_5, value=insert)
name_to_edit = StringInput("A-EL-C")
name_to_replace = StringInput("EL-C-A")
replace = String.Replace(searchFor=name_to_edit, replaceWith=name_to_replace)  # unwired: string

# group: Choose View Type
code_block_8 = CodeBlock { "Floor Plan"; "Ceiling Plan"; }
filter_by_view_type = Python(IN[1]=code_block_8.out1)  # CPython3; unwired: IN[0]
# ---------- filter_by_view_type.python (50 lines) ----------
import clr
import math
from io import StringIO

import Autodesk
import RevitServices
from Autodesk.Revit.DB import *
from Autodesk.Revit.DB import FilteredElementCollector, Dimension
from Autodesk.Revit.DB import Point, ViewType
from RevitServices.Persistence import DocumentManager
from RevitServices.Transactions import TransactionManager
from Autodesk.Revit.DB import Dimension, Line, XYZ


clr.AddReference('RevitServices')
clr.AddReference('RevitAPI')
clr.AddReference('RevitNodes')
clr.AddReference('RevitAPIUI')
# For Outputting print to watch node
output = StringIO()
sys.stdout = output

doc = DocumentManager.Instance.CurrentDBDocument
elements = UnwrapElement(IN[0])

view_type = IN[1]

result = []

def transaction(func):
    def wrapper(*args, **kwargs):
            TransactionManager.Instance.EnsureInTransaction(doc)
            func(*args, **kwargs)
            TransactionManager.Instance.TransactionTaskDone()
    return wrapper

@transaction
def start():
    for i in elements:
        if view_type == "Floor Plan" and i.ViewType == ViewType.FloorPlan:
            result.append(i)
            continue
        if view_type == "Ceiling Plan" and i.ViewType == ViewType.CeilingPlan:
            result.append(i)
            continue

start()

# OUT = output.getvalue()
OUT = result
# ----------------------------------------

watch = Watch(filter_by_view_type)
