# Dynamo graph Room Cropbox.dyn (Dynamo 2.13.1.3887)

current = Document.Current()
activeView = Document.ActiveView(document=current)
select_model_element = DSModelElementSelection()  # 1 picked in the model
python_script = Python(IN[0]=activeView, IN[1]=select_model_element)  # CPython3
# ---------- python_script.python (56 lines) ----------
import clr
import math
from io import StringIO

import Autodesk
import RevitServices
from Autodesk.Revit.DB import *
from Autodesk.Revit.DB import FilteredElementCollector, Dimension
from Autodesk.Revit.DB import Point
from RevitServices.Persistence import DocumentManager
from RevitServices.Transactions import TransactionManager
from Autodesk.Revit.DB import Dimension, Line, XYZ


clr.AddReference('RevitServices')
clr.AddReference('RevitAPI')
clr.AddReference('RevitNodes')
clr.AddReference('RevitAPIUI')
# For Outputting print to watch node
output = StringIO()
sys.stdout = output

doc = DocumentManager.Instance.CurrentDBDocument

view = UnwrapElement(IN[0])
room = UnwrapElement(IN[1])

crop_manager = view.GetCropRegionShapeManager()
crop_shape = crop_manager.GetCropShape()[0]



members = dir(IN[1])

TransactionManager.Instance.EnsureInTransaction(doc)

options = SpatialElementBoundaryOptions()
boundary = room.GetBoundarySegments(options)


curves = []

# Loop through the boundary segments
for segmentList in boundary:
    for segment in segmentList:
        curves.append(segment.GetCurve())

loop = CurveLoop.Create(curves)

TransactionManager.Instance.TransactionTaskDone()

print(curves)



OUT = output.getvalue()
# ----------------------------------------
watch = Watch(python_script)
