# Dynamo graph level changer.dyn (Dynamo 3.0.3.7597)

boolean = BoolSelector(true)
file_path = Filename("C:\Users\User\Documents\Dynamo Scripts\level changer.py")
file_from_path = FileObject(path=file_path)
if_ = RefactoredIf(test=boolean, true=file_from_path, false=file_from_path)
readText = FileSystem.ReadText(file=if_)
python_script_from_string = PythonStringNode(script=readText)  # CPython3; unwired: IN[0]
watch = Watch(python_script_from_string)
